# Grasshopper definition exhaustive.gh (Grasshopper 1.0.7)

parameter_generator = GhPythonScript()  # -> out, param
# ---------- parameter_generator: Python ----------
__author__ = "tmendeze"

import rhinoscriptsyntax as rs

shading         = [0, 1]
wwr             = [0, 20, 40, 60, 80]
glazing         = [2, 3]
shgc            = [0, 1]
ext_ins_mat     = [0, 1]
ext_ins_t       = [0, 4, 8]
int_ins_mat     = [0, 1]
int_ins_t       = [6, 8, 10]

param = []
for s in shading:
    for w in wwr:
        for g in glazing:
            for shg in shgc:
                for eim in ext_ins_mat:
                    for eit in ext_ins_t:
                        for iim in int_ins_mat:
                            for iit in int_ins_t:
                                param.append([s, w, g, shg, eim, eit, iim, iit])
# ---------- end parameter_generator ----------
parameters = GhPythonScript(param=parameter_generator.param, i=Slider(459, range=0..1439))  # -> out, shading, wwr, glazing, shgc, ext_ins_mat, ext_ins_t, int_ins_mat, int_ins_t; inputs param: list, i: Int32
# ---------- parameters: Python ----------
__author__ = "tmendeze"

import rhinoscriptsyntax as rs

p = param[i]

shading         = p[0]
wwr             = p[1]
glazing         = p[2]
shgc            = p[3]
ext_ins_mat     = p[4]
ext_ins_t       = p[5]
int_ins_mat     = p[6]
int_ins_t       = p[7]
# ---------- end parameters ----------
panel = Panel([parameters.shading, parameters.wwr, parameters.glazing, parameters.shgc, parameters.ext_ins_mat, parameters.ext_ins_t, parameters.int_ins_mat, parameters.int_ins_t])
